# Grasshopper definition Async Test-Cluster.gh (Grasshopper 1.0.7)

cluster = Cluster(A=Slider(61, range=0..100))
panel = Panel(cluster)

# ==== cluster Cluster
A = ClusterInput()
addition = Addition(A=A, B=1)
R = ClusterOutput(addition)
