# Grasshopper definition Async Test-Continue.gh (Grasshopper 1.0.7)

fifth = CSharpScript(x=Slider(74, range=0..100))  # -> out, A
# ---------- fifth: C# usings ----------
using System.Threading;
# ---------- fifth: C# ----------
    Thread.Sleep(5000);
    A = x;
# ---------- end fifth ----------
panel = Panel(fifth.A)
