# Grasshopper definition Async Test-MultiTask.gh (Grasshopper 1.0.7)

first = CSharpScript(y=Slider(12, range=0..100))  # -> out, A
# ---------- first: C# usings ----------
using System.Threading;
# ---------- first: C# ----------
    Thread.Sleep(1000);
    //this.Component.Message = this.Component.Phase.ToString();
# ---------- end first ----------
sixth = CSharpScript()  # -> out, A; same code as first
second = CSharpScript(x=first.A)  # -> out, A; same code as first
panel = Panel(sixth.A)
fifth = CSharpScript(x=second.A, y=sixth.A)  # -> out, A; same code as first
third = CSharpScript(x=first.A, y=second.A)  # -> out, A; same code as first
forth = CSharpScript(x=fifth.A, y=third.A)  # -> out, A; same code as first
